# Dynamo graph AQTO_B Debug.dyn (Dynamo 2.6.1.8786)
# packages: bimorphNodes 3.0.3, spring nodes 204.1.0, RegEx 1.2.2, Data-Shapes 2021.2.94, Clockwork for Dynamo 2.x 2.3.0, archi-lab.net 2021.25.19

# group: GET
# note: Get objects and data from Revit

# group: INPUT
# note: Data input

# group: FUNCTION
# note: Data manipulation

# group: OUTPUT
# note: Object/ data creation in host application

# group: SET
# note: Set parameter values of Revit Objects

# group: INSPECT
# note: Debug nodes

# group: TEMP
# note: Internal notes

string = StringInput("""Takeoff File
Close out of file first""")  # graph input

# group: Popup interface for Read/Write file input
string_2 = StringInput("SA-QTO ENGINE")
code_block = CodeBlock { null; }
string_3 = StringInput("OK")
filepath_data = Custom[FilePath Data](ButtonText=string)  # package Data-Shapes; Create filepath input for UI.MultipleInputForm ++ . Check out www.data-shapes.net for more infos !
boolean = BoolSelector(true)
string_4 = StringInput("CANCEL")
multipleinputform = Custom[MultipleInputForm ++](Description_optional=string_2, Logo_optional=code_block, ButtonText_optional=string_3, Inputs=filepath_data, Toggle=boolean, CancelButtonText_optional=string_4)  # package Data-Shapes; Create a form with multiple inputs. see www.data-shapes.net for tutorials and infos!
code_block_2 = CodeBlock { 0; }
getItemAtIndex = List.GetItemAtIndex(list=multipleinputform.User_Inputs, index=code_block_2)
code_block_3 = CodeBlock { 50; }

# group: Read Query file
file_from_path = FileObject(path=getItemAtIndex)
string_5 = StringInput("Sheet1")
importExcel = Data.ImportExcel(file=file_from_path, sheetName=string_5)

# group: remove non-match (null) & header row
code_block_4 = CodeBlock { 4; }
getItemAtIndex_2 = List.GetItemAtIndex(list=importExcel@L2, index=code_block_4)
isNull = Object.IsNull(obj=getItemAtIndex_2)
code_block_5 = CodeBlock { true; }
allIndicesOf = List.AllIndicesOf(list=isNull, item=code_block_5)
removeItemAtIndex = List.RemoveItemAtIndex(list=importExcel, indices=allIndicesOf)
code_block_6 = CodeBlock { 0; }
removeItemAtIndex_2 = List.RemoveItemAtIndex(list=removeItemAtIndex, indices=code_block_6)

# group: get queries
return_ = CodeBlock { 0; 1; 8; }
getItemAtIndex_3 = List.GetItemAtIndex(list=removeItemAtIndex_2@L2, index=return_.out0)
getItemAtIndex_4 = List.GetItemAtIndex(list=removeItemAtIndex_2@L2, index=return_.out1)
schedule = CodeBlock { 2; }
getItemAtIndex_5 = List.GetItemAtIndex(list=removeItemAtIndex_2@L2, index=schedule)
header_1 = CodeBlock { 3; 4; }
getItemAtIndex_6 = List.GetItemAtIndex(list=removeItemAtIndex_2@L2, index=header_1.out1)
getItemAtIndex_7 = List.GetItemAtIndex(list=removeItemAtIndex_2@L2, index=header_1.out0)
header_2 = CodeBlock { 5; 6; }
getItemAtIndex_8 = List.GetItemAtIndex(list=removeItemAtIndex_2@L2, index=header_2.out0)
return_2 = CodeBlock { 7; }
getItemAtIndex_9 = List.GetItemAtIndex(list=removeItemAtIndex_2@L2, index=return_2)
getItemAtIndex_10 = List.GetItemAtIndex(list=removeItemAtIndex_2@L2, index=header_2.out1)
getItemAtIndex_11 = List.GetItemAtIndex(list=removeItemAtIndex_2@L2, index=return_.out2)

# group: Get Schedule from Revit
getData = Revit.Schedule.GetData(scheduleView=getItemAtIndex_5)
watch = Watch(getData)
code_block_7 = CodeBlock { 0; }
getItemAtIndex_12 = List.GetItemAtIndex(list=watch@L3, index=code_block_7)

# group: Search for Header 1
transpose = List.Transpose(lists=watch@L3)
code_block_8 = CodeBlock { true; }
contains = String.Contains(str=getItemAtIndex_12, searchFor=getItemAtIndex_7, ignoreCase=code_block_8)
allIndicesOf_2 = List.AllIndicesOf(list=contains@L2, item=code_block_8)
code_block_9 = CodeBlock { 0; }
getItemAtIndex_13 = List.GetItemAtIndex(list=allIndicesOf_2@L2, index=code_block_9)

# group: Search for Value 1
options = RegexOptions("IgnoreCase")
byPattern = RegularExpressions.Regex.ByPattern(pattern=getItemAtIndex_6, options=options)
getItemAtIndex_14 = List.GetItemAtIndex(list=transpose@L3, index=getItemAtIndex_13@L1)
isMatch = RegularExpressions.Regex.IsMatch(regex=byPattern, input=getItemAtIndex_14@L3)
code_block_10 = CodeBlock { true; }
allIndicesOf_3 = List.AllIndicesOf(list=isMatch@L2, item=code_block_10)

# group: Filter for two header searches
isNull_2 = Object.IsNull(obj=getItemAtIndex_8)
filterByBoolMask = List.FilterByBoolMask(list=getItemAtIndex_12, mask=isNull_2)
filterByBoolMask_2 = List.FilterByBoolMask(list=getItemAtIndex_9, mask=isNull_2)
filterByBoolMask_3 = List.FilterByBoolMask(list=getItemAtIndex_10, mask=isNull_2)
filterByBoolMask_4 = List.FilterByBoolMask(list=getItemAtIndex_8, mask=isNull_2)

# group: Value 2 Boolean Gate
getItemAtIndex_15 = List.GetItemAtIndex(list=watch@L3, index=allIndicesOf_3@L2)
watch_2 = Watch(isNull_2)
filterByBoolMask_5 = List.FilterByBoolMask(list=getItemAtIndex_15, mask=watch_2)

# group: Search Return 1 (Will be empty if Value 2 is not null)
transpose_2 = List.Transpose(lists=filterByBoolMask_5.in@L3)
contains_2 = String.Contains(str=filterByBoolMask.in, searchFor=filterByBoolMask_2.in, ignoreCase=code_block_10)
allIndicesOf_4 = List.AllIndicesOf(list=contains_2@L2, item=code_block_10)
code_block_11 = CodeBlock { 0; }
getItemAtIndex_16 = List.GetItemAtIndex(list=allIndicesOf_4@L2, index=code_block_11)

# group: Return Summed Value 1
getItemAtIndex_17 = List.GetItemAtIndex(list=transpose_2@L3, index=getItemAtIndex_16@L1)
toNumber = String.ToNumber(str=getItemAtIndex_17)

# group: Search for Header 2
code_block_12 = CodeBlock { true; }
contains_3 = String.Contains(str=filterByBoolMask.out, searchFor=filterByBoolMask_4.out, ignoreCase=code_block_12)
allIndicesOf_5 = List.AllIndicesOf(list=contains_3@L2, item=code_block_12)
code_block_13 = CodeBlock { 0; }
getItemAtIndex_18 = List.GetItemAtIndex(list=allIndicesOf_5@L2, index=code_block_13)

# group: Search for Value 2
code_block_14 = CodeBlock { true; }
options_2 = RegexOptions("IgnoreCase")
byPattern_2 = RegularExpressions.Regex.ByPattern(pattern=filterByBoolMask_3.out, options=options_2)
transpose_3 = List.Transpose(lists=filterByBoolMask_5.out@L3)
getItemAtIndex_19 = List.GetItemAtIndex(list=transpose_3@L3, index=getItemAtIndex_18@L1)
isMatch_2 = RegularExpressions.Regex.IsMatch(regex=byPattern_2@L3, input=getItemAtIndex_19@L4)
allIndicesOf_6 = List.AllIndicesOf(list=isMatch_2@L2, item=code_block_14)

# group: Search Return 2
transpose_4 = List.Transpose(lists=filterByBoolMask_5.out@L3)
contains_4 = String.Contains(str=filterByBoolMask.out, searchFor=filterByBoolMask_2.out, ignoreCase=code_block_14)
allIndicesOf_7 = List.AllIndicesOf(list=contains_4@L2, item=code_block_14)
code_block_15 = CodeBlock { 0; }
getItemAtIndex_20 = List.GetItemAtIndex(list=allIndicesOf_7@L2, index=code_block_15)

# group: Return Summed Value 2
getItemAtIndex_21 = List.GetItemAtIndex(list=transpose_4@L3, index=getItemAtIndex_20@L1)
getItemAtIndex_22 = List.GetItemAtIndex(list=getItemAtIndex_21@L2, index=allIndicesOf_6@L2)
toNumber_2 = String.ToNumber(str=getItemAtIndex_22)

# group: replaces all nulls with 0 value to preserve list structure
code_block_16 = CodeBlock { 0; }
replaceNull = Custom[List.ReplaceNull](seq=toNumber@L2, replacement=code_block_16)  # package Clockwork for Dynamo 2.x; Replaces all null values within a given list with a substitute
replaceNull_2 = Custom[List.ReplaceNull](seq=toNumber_2@L2, replacement=code_block_16)

# group (continued): Return Summed Value 1
sum = Math.Sum(values=replaceNull@L2)

# group (continued): Return Summed Value 2
sum_2 = Math.Sum(values=replaceNull_2@L2)

# group: Merge searches, replace nulls of each schedules)
ꟿ_list_mergebyboolmask = Custom[ꟿ List.MergeByBoolMask](mask=sum, trueList=sum_2, falseList=watch_2)  # package spring nodes; Merge two lists by a boolean mask list. The true count in the mask should be the same as the length of the true list and vice versa for the false list.
ceiling = Math.Ceiling(number=ꟿ_list_mergebyboolmask)
code_block_17 = CodeBlock { "0"; }
replaceNull_3 = Custom[List.ReplaceNull](seq=ceiling, replacement=code_block_17)

# group: Assign Units
string_6 = StringInput("sf,cy,lf,ea,lf,tons")
code_block_18 = CodeBlock { ","; }
split = String.Split(str=string_6, separator0=code_block_18)
string_7 = StringInput("area,volume,length,count,perimeter,tonnage")
split_2 = String.Split(str=string_7, separator0=code_block_18)
code_block_19 = CodeBlock { true; }
contains_5 = String.Contains(str=getItemAtIndex_9@L1, searchFor=split_2, ignoreCase=code_block_19)
indexOf = List.IndexOf(list=contains_5@L2, element=code_block_19)
getItemAtIndex_23 = List.GetItemAtIndex(list=split, index=indexOf)

# group: Format Data, write to Excel
string_8 = StringInput("CODE,DESCRIPTION,QUANTITY,UNIT,COMMENTS")
code_block_20 = CodeBlock { ","; }
split_3 = String.Split(str=string_8, separator0=code_block_20)
list_create = List.Create(item0=getItemAtIndex_3, item1=getItemAtIndex_4, item2=replaceNull_3, item3=getItemAtIndex_23, item4=getItemAtIndex_11)
transpose_5 = List.Transpose(lists=list_create)
addItemToFront = List.AddItemToFront(item=split_3, list=transpose_5)
passthrough = Custom[Passthrough](passThrough=getItemAtIndex, waitFor=addItemToFront)  # package Clockwork for Dynamo 2.x; Forces a sequential order of execution. The node wired into the output of the Passthrough node will be executed *after* the node wired into the waitFor input (e.g. important for some Revit operations). The value of the passThrough input will be passed on to the node wired into the output port of the Passthrough node.
string_9 = StringInput("02 Takeoffs")
code_block_21 = CodeBlock { 0; true; }
exportExcel = Data.ExportExcel(filePath=passthrough, sheetName=string_9, startRow=code_block_21.out0, startCol=code_block_21.out0, data=addItemToFront, overWrite=code_block_21.out1)

# group: INSTRUCTIONS -Must be run in manual mode Plugin Requisites -Regex v 1.2.2 -Datashapes 2021.02.94
code_block_22 = CodeBlock {  }
string_10 = StringInput("""https://www.youtube.com/watch?v=rhzKDrUiJVk

REGEX
https://www.youtube.com/watch?v=YhiXCmWbHzg

Popup imput
https://data-shapes.io/2016/11/03/multi-user-input-form-with-dynamo/""")

# group: Assign Division to Elements
element_by_id = ElementById()  # unwired: Id
watch_3 = Watch(getItemAtIndex_3)
lastItem = List.LastItem(list=getItemAtIndex_15@@L2)  # frozen
count = List.Count(list=lastItem@L2)
ofRepeatedItem = List.OfRepeatedItem(item=watch_3@L1, amount=count, lacing=Shortest)
flatten = List.Flatten(list=ofRepeatedItem)
byElementId = archilab.Revit.Selection.Select.ByElementId(id=lastItem)
flatten_2 = List.Flatten(list=byElementId)
string_11 = StringInput("**Division")

# group: Write multiple divisions to element
flatten_3 = List.Flatten(list=lastItem)
boolean_2 = BoolSelector(false)
clean = List.Clean(list=flatten_3, preserveIndices=boolean_2)
countOccurences = Custom[List.CountOccurences](seq=clean)  # package Clockwork for Dynamo 2.x; Counts the number of occurences of each unique element in a given list
code_block_23 = CodeBlock { ""; }
contains_6 = List.Contains(list=countOccurences.uniqueElements@L1, item=code_block_23)
filterByBoolMask_6 = List.FilterByBoolMask(list=countOccurences.uniqueElements, mask=contains_6)
filterByBoolMask_7 = List.FilterByBoolMask(list=countOccurences.count, mask=contains_6)
code_block_24 = CodeBlock { 1; }
gt = filterByBoolMask_7.out > code_block_24
filterByBoolMask_8 = List.FilterByBoolMask(list=filterByBoolMask_6.out, mask=gt)
index_of_values_with_more_than = List.AllIndicesOf(list=clean, item=filterByBoolMask_8.in)  # "Index of values with more than one div codes"
getItemAtIndex_24 = List.GetItemAtIndex(list=flatten, index=index_of_values_with_more_than)
lastItem_2 = List.LastItem(list=index_of_values_with_more_than@L2)
code_block_25 = CodeBlock { ","; }
join = String.Join(separator=code_block_25, string0=getItemAtIndex_24@L2)
replaceItemAtIndex = Custom[List.ReplaceItemAtIndex+](seq=flatten, indices=lastItem_2, replacement=join)  # package Clockwork for Dynamo 2.x; Replaces the item at a given index of a list by another item. Unlike the OOTB node, it can replace items at multiple indeces.

code_block_26 = CodeBlock { 1; }

# group: edit out duplicate divisions??
uniqueItems = List.UniqueItems(list=getItemAtIndex_24@L2)  # frozen
count_2 = List.Count(list=uniqueItems@L2)
eq = Equals(x=count_2, y=code_block_26)
filterByBoolMask_9 = List.FilterByBoolMask(list=uniqueItems, mask=eq)

# group (continued): Assign Division to Elements
setParameterByName = Element.SetParameterByName(element=flatten_2, parameterName=string_11, value=replaceItemAtIndex)

# group: Assign "Not Quantified" to all elements w Blank **Division Parameter
all_elements_in_active_view = ElementsInView()  # frozen
passthrough_2 = Custom[Passthrough](passThrough=all_elements_in_active_view, waitFor=setParameterByName)
code_block_27 = CodeBlock { "**Division"; }
getParameterValueByName = Element.GetParameterValueByName(element=passthrough_2, parameterName=code_block_27)
code_block_28 = CodeBlock { ""; }
eq_2 = getParameterValueByName == code_block_28
filterByBoolMask_10 = List.FilterByBoolMask(list=passthrough_2, mask=eq_2)
code_block_29 = CodeBlock { "Not Quantified"; }
setParameterByName_2 = Element.SetParameterByName(element=filterByBoolMask_10.in, parameterName=code_block_27, value=code_block_29)

# group: Delete Existing ** Views
view_type = ViewTypesUi("ThreeD")
passthrough_3 = Custom[Passthrough](passThrough=view_type, waitFor=setParameterByName_2)
getByType = archilab.Revit.Views.Views.GetByType(viewType=passthrough_3)
string_from_object = FromObject(obj=getByType)
code_block_30 = CodeBlock { "**"; }
contains_7 = String.Contains(str=string_from_object, searchFor=code_block_30, lacing=CrossProduct)
filterByBoolMask_11 = List.FilterByBoolMask(list=getByType, mask=contains_7)
delete = archilab.Revit.Elements.Elements.Delete(element=filterByBoolMask_11.in)

# group: Get All Category Based Schedules
view_type_2 = ViewTypesUi("Schedule")
passthrough_4 = Custom[Passthrough](passThrough=view_type_2, waitFor=delete)
getByType_2 = archilab.Revit.Views.Views.GetByType(viewType=passthrough_4)
string_from_object_2 = FromObject(obj=getByType_2)
code_block_31 = CodeBlock { "**"; }
contains_8 = String.Contains(str=string_from_object_2, searchFor=code_block_31)
filterByBoolMask_12 = List.FilterByBoolMask(list=getByType_2, mask=contains_8)
code_block_32 = CodeBlock { "**Material"; }
code_block_33 = CodeBlock { "**Space"; }
list_create_2 = List.Create(item0=code_block_32, item1=code_block_33)
code_block_34 = CodeBlock { true; }
code_block_35 = CodeBlock { true; }

string_from_object_3 = FromObject(obj=filterByBoolMask_12.in)

# group (continued): Get All Category Based Schedules
contains_9 = String.Contains(str=string_from_object_3@L1, searchFor=list_create_2, ignoreCase=code_block_34)
contains_10 = List.Contains(list=contains_9@L2, item=code_block_35)

filterByBoolMask_13 = List.FilterByBoolMask(list=filterByBoolMask_12.in, mask=contains_10)

# group: Get **Division Parameter Vals
code_block_36 = CodeBlock { true; false; }
getData_2 = Revit.Schedule.GetData(scheduleView=filterByBoolMask_13.out, removeHeading=code_block_36.out0)
firstItem = List.FirstItem(list=getData_2@L2)

# group: Get Unique Div Prefixes
code_block_37 = CodeBlock { "Not Quantified"; }
contains_11 = List.Contains(list=firstItem@L1, item=code_block_37)
filterByBoolMask_14 = List.FilterByBoolMask(list=firstItem, mask=contains_11)
code_block_38 = CodeBlock { ","; " "; }
split_4 = String.Split(str=filterByBoolMask_14.out, separator0=code_block_38.out0)
flatten_4 = List.Flatten(list=split_4)
split_5 = String.Split(str=flatten_4, separator0=code_block_38.out1)
code_block_39 = CodeBlock { 0; }
getItemAtIndex_25 = List.GetItemAtIndex(list=split_5@L2, index=code_block_39)
code_block_40 = CodeBlock { " "; }
add = getItemAtIndex_25 + code_block_40
join_2 = List.Join(list0=add, list1=filterByBoolMask_14.in)
uniqueItems_2 = List.UniqueItems(list=join_2)

# group: Filter Out Non-Matching Elements
lastItem_3 = List.LastItem(list=getData_2@L2)
string_from_object_4 = FromObject(obj=firstItem)
string_from_object_5 = FromObject(obj=uniqueItems_2)
code_block_41 = CodeBlock { true; }
contains_12 = String.Contains(str=string_from_object_4, searchFor=string_from_object_5@L1, ignoreCase=code_block_41)
filterByBoolMask_15 = List.FilterByBoolMask(list=lastItem_3, mask=contains_12@L2)
code_block_42 = CodeBlock { ""; }
ne = filterByBoolMask_15.out != code_block_42
filterByBoolMask_16 = List.FilterByBoolMask(list=filterByBoolMask_15.out, mask=ne)
byElementId_2 = archilab.Revit.Selection.Select.ByElementId(id=filterByBoolMask_16.in)
element_by_id_2 = ElementById(Id=filterByBoolMask_16.in)

# group: Creates 3D Views, (1) per unique div
code_block_43 = CodeBlock { "**DIV "; }
code_block_44 = CodeBlock { -1; }
dropItems = List.DropItems(list=uniqueItems_2, amount=code_block_44)
add_2 = code_block_43 + dropItems
code_block_45 = CodeBlock { "**"; }
lastItem_4 = List.LastItem(list=uniqueItems_2)
add_3 = code_block_45 + lastItem_4
join_3 = List.Join(list0=add_2, list1=add_3)
python_script = Python(IN[0]=join_3)
# ---------- python_script.python (61 lines) ----------
# Copyright(c) 2018, Konrad K Sobon
# @arch_laboratory, http://archi-lab.net

import clr
clr.AddReference("RevitNodes")
import Revit
clr.ImportExtensions(Revit.Elements)

clr.AddReference("RevitServices")
import RevitServices
from RevitServices.Persistence import DocumentManager
from RevitServices.Transactions import TransactionManager
doc = DocumentManager.Instance.CurrentDBDocument

clr.AddReference("RevitAPI")
from Autodesk.Revit.DB import *

import System
from System import Array
from System.Collections.Generic import *

import sys
pyt_path = r'C:\Program Files (x86)\IronPython 2.7\Lib'
sys.path.append(pyt_path)


def process_list(_func, _list):
    return map(lambda x: process_list(_func, x) if type(x) == list else _func(x), _list)

def create_3dview(name):
	views = FilteredElementCollector(doc).OfClass(View3D).ToElements()
	
	#(Konrad) Check for existing view
	view = None
	for v in views:
		if v.Name == name:
			view = v
			break
	
	if view == None:
		vft = next((x for x in FilteredElementCollector(doc).OfClass(ViewFamilyType).ToElements() if x.ViewFamily == ViewFamily.ThreeDimensional), None)
		view = View3D.CreateIsometric(doc, vft.Id)
		view.Name = name
	return view

try:
    errorReport = None
    TransactionManager.Instance.EnsureInTransaction(doc)
    output = process_list(create_3dview,IN[0])
  	
    TransactionManager.Instance.TransactionTaskDone()

except:
    import traceback
    errorReport = traceback.format_exc()

if None == errorReport:
    OUT = output
else:
    OUT = errorReport
    
# ----------------------------------------

# group: Filter Newly Created 3D Views
watch_4 = Watch(uniqueItems_2)
view_type_3 = ViewTypesUi("ThreeD")
passthrough_5 = Custom[Passthrough](passThrough=view_type_3, waitFor=python_script)
getByType_3 = archilab.Revit.Views.Views.GetByType(viewType=passthrough_5)
string_from_object_6 = FromObject(obj=getByType_3)
code_block_46 = CodeBlock { "**"; }
code_block_47 = CodeBlock { true; }
contains_13 = String.Contains(str=string_from_object_6, searchFor=code_block_46, ignoreCase=code_block_47)
filterByBoolMask_17 = List.FilterByBoolMask(list=getByType_3, mask=contains_13)
code_block_48 = CodeBlock { 1; }
chop = List.Chop(list=filterByBoolMask_17.in, lengths=code_block_48)

# group: Hide Elements In View, By Division
boolean_3 = BoolSelector(true)
hideElements = Custom[View.HideElements](element=byElementId_2@L2, view=chop@L2, runIt=boolean_3)  # package archi-lab.net; This node will hide elements in specified view.

watch_5 = Watch(filterByBoolMask_13.out)
watch_6 = Watch(transpose_3)
